test file "UrbanEV_BBW_All_Scenarios_Test_Manager_v2"

suite "New Test Suite 1"

  case "New Test Case 1" [baseline]

suite "Emergency Brake-Request Logic Verification - All Scenarios"

  case "SCN-01 Normal following" [simulation]
    description: Scenario: SCN-01
      Description: Normal following
      Expected warning state: SAFE
      Expected warning_state_code: 0
      Expected brake_request: 0
      Expected state_match: 1
    model urban_ev_bbw_warning_logic_test_validation
    post-load callback:
      set_param('urban_ev_bbw_warning_logic_test_validation/01_Scenario_Definition/SCN05_ego_speed_kmh','Value','20');
      set_param('urban_ev_bbw_warning_logic_test_validation/01_Scenario_Definition/SCN05_target_distance_m','Value','25');
      set_param('urban_ev_bbw_warning_logic_test_validation/01_Scenario_Definition/SCN05_relative_speed_kmh','Value','5');
      set_param('urban_ev_bbw_warning_logic_test_validation/01_Scenario_Definition/SCN05_friction_mu','Value','0.75');
      set_param('urban_ev_bbw_warning_logic_test_validation/01_Scenario_Definition/SCN05_actuator_delay_s','Value','0.2');
      set_param('urban_ev_bbw_warning_logic_test_validation/01_Scenario_Definition/SCN05_expected_state_code','Value','0');
    custom criteria:
      ws = test.sltest_simout.get('sim_warning_state_code');
      br = test.sltest_simout.get('sim_brake_request');
      sm = test.sltest_simout.get('sim_state_match');
      test.verifyEqual(double(ws(end)), double(0), 'warning_state_code mismatch');
      test.verifyEqual(double(br(end)), double(0), 'brake_request mismatch');
      test.verifyEqual(double(sm(end)), double(1), 'state_match must be 1');

  case "SCN-02 Close but not critical target" [simulation]
    description: Scenario: SCN-02
      Description: Close but not critical target
      Expected warning state: CAUTION
      Expected warning_state_code: 1
      Expected brake_request: 0
      Expected state_match: 1
    model urban_ev_bbw_warning_logic_test_validation
    post-load callback:
      set_param('urban_ev_bbw_warning_logic_test_validation/01_Scenario_Definition/SCN05_ego_speed_kmh','Value','30');
      set_param('urban_ev_bbw_warning_logic_test_validation/01_Scenario_Definition/SCN05_target_distance_m','Value','10');
      set_param('urban_ev_bbw_warning_logic_test_validation/01_Scenario_Definition/SCN05_relative_speed_kmh','Value','10');
      set_param('urban_ev_bbw_warning_logic_test_validation/01_Scenario_Definition/SCN05_friction_mu','Value','0.75');
      set_param('urban_ev_bbw_warning_logic_test_validation/01_Scenario_Definition/SCN05_actuator_delay_s','Value','0.2');
      set_param('urban_ev_bbw_warning_logic_test_validation/01_Scenario_Definition/SCN05_expected_state_code','Value','1');
    custom criteria:
      ws = test.sltest_simout.get('sim_warning_state_code');
      br = test.sltest_simout.get('sim_brake_request');
      sm = test.sltest_simout.get('sim_state_match');
      test.verifyEqual(double(ws(end)), double(1), 'warning_state_code mismatch');
      test.verifyEqual(double(br(end)), double(0), 'brake_request mismatch');
      test.verifyEqual(double(sm(end)), double(1), 'state_match must be 1');

  case "SCN-03 High closing risk" [simulation]
    description: Scenario: SCN-03
      Description: High closing risk
      Expected warning state: WARNING
      Expected warning_state_code: 2
      Expected brake_request: 0
      Expected state_match: 1
    model urban_ev_bbw_warning_logic_test_validation
    post-load callback:
      set_param('urban_ev_bbw_warning_logic_test_validation/01_Scenario_Definition/SCN05_ego_speed_kmh','Value','30');
      set_param('urban_ev_bbw_warning_logic_test_validation/01_Scenario_Definition/SCN05_target_distance_m','Value','8');
      set_param('urban_ev_bbw_warning_logic_test_validation/01_Scenario_Definition/SCN05_relative_speed_kmh','Value','15');
      set_param('urban_ev_bbw_warning_logic_test_validation/01_Scenario_Definition/SCN05_friction_mu','Value','0.75');
      set_param('urban_ev_bbw_warning_logic_test_validation/01_Scenario_Definition/SCN05_actuator_delay_s','Value','0.2');
      set_param('urban_ev_bbw_warning_logic_test_validation/01_Scenario_Definition/SCN05_expected_state_code','Value','2');
    custom criteria:
      ws = test.sltest_simout.get('sim_warning_state_code');
      br = test.sltest_simout.get('sim_brake_request');
      sm = test.sltest_simout.get('sim_state_match');
      test.verifyEqual(double(ws(end)), double(2), 'warning_state_code mismatch');
      test.verifyEqual(double(br(end)), double(0), 'brake_request mismatch');
      test.verifyEqual(double(sm(end)), double(1), 'state_match must be 1');

  case "SCN-04 Wet-road warning case" [simulation]
    description: Scenario: SCN-04
      Description: Wet-road warning case
      Expected warning state: WARNING
      Expected warning_state_code: 2
      Expected brake_request: 0
      Expected state_match: 1
    model urban_ev_bbw_warning_logic_test_validation
    post-load callback:
      set_param('urban_ev_bbw_warning_logic_test_validation/01_Scenario_Definition/SCN05_ego_speed_kmh','Value','30');
      set_param('urban_ev_bbw_warning_logic_test_validation/01_Scenario_Definition/SCN05_target_distance_m','Value','9');
      set_param('urban_ev_bbw_warning_logic_test_validation/01_Scenario_Definition/SCN05_relative_speed_kmh','Value','15');
      set_param('urban_ev_bbw_warning_logic_test_validation/01_Scenario_Definition/SCN05_friction_mu','Value','0.45');
      set_param('urban_ev_bbw_warning_logic_test_validation/01_Scenario_Definition/SCN05_actuator_delay_s','Value','0.2');
      set_param('urban_ev_bbw_warning_logic_test_validation/01_Scenario_Definition/SCN05_expected_state_code','Value','2');
    custom criteria: same code as in custom criteria of case "SCN-03 High closing risk"

  case "SCN-05 Sudden stationary obstacle" [simulation]
    description: Scenario: SCN-05
      Description: Sudden stationary obstacle
      Expected warning state: EMERGENCY_BRAKE
      Expected warning_state_code: 3
      Expected brake_request: 1
      Expected state_match: 1
    model urban_ev_bbw_warning_logic_test_validation
    post-load callback:
      set_param('urban_ev_bbw_warning_logic_test_validation/01_Scenario_Definition/SCN05_ego_speed_kmh','Value','40');
      set_param('urban_ev_bbw_warning_logic_test_validation/01_Scenario_Definition/SCN05_target_distance_m','Value','10');
      set_param('urban_ev_bbw_warning_logic_test_validation/01_Scenario_Definition/SCN05_relative_speed_kmh','Value','40');
      set_param('urban_ev_bbw_warning_logic_test_validation/01_Scenario_Definition/SCN05_friction_mu','Value','0.75');
      set_param('urban_ev_bbw_warning_logic_test_validation/01_Scenario_Definition/SCN05_actuator_delay_s','Value','0.2');
      set_param('urban_ev_bbw_warning_logic_test_validation/01_Scenario_Definition/SCN05_expected_state_code','Value','3');
    custom criteria:
      ws = test.sltest_simout.get('sim_warning_state_code');
      br = test.sltest_simout.get('sim_brake_request');
      sm = test.sltest_simout.get('sim_state_match');
      test.verifyEqual(double(ws(end)), double(3), 'warning_state_code mismatch');
      test.verifyEqual(double(br(end)), double(1), 'brake_request mismatch');
      test.verifyEqual(double(sm(end)), double(1), 'state_match must be 1');

  case "SCN-06 Delay-sensitive wet case" [simulation]
    description: Scenario: SCN-06
      Description: Delay-sensitive wet case
      Expected warning state: WARNING
      Expected warning_state_code: 2
      Expected brake_request: 0
      Expected state_match: 1
    model urban_ev_bbw_warning_logic_test_validation
    post-load callback:
      set_param('urban_ev_bbw_warning_logic_test_validation/01_Scenario_Definition/SCN05_ego_speed_kmh','Value','30');
      set_param('urban_ev_bbw_warning_logic_test_validation/01_Scenario_Definition/SCN05_target_distance_m','Value','8.8');
      set_param('urban_ev_bbw_warning_logic_test_validation/01_Scenario_Definition/SCN05_relative_speed_kmh','Value','10');
      set_param('urban_ev_bbw_warning_logic_test_validation/01_Scenario_Definition/SCN05_friction_mu','Value','0.45');
      set_param('urban_ev_bbw_warning_logic_test_validation/01_Scenario_Definition/SCN05_actuator_delay_s','Value','0.2');
      set_param('urban_ev_bbw_warning_logic_test_validation/01_Scenario_Definition/SCN05_expected_state_code','Value','2');
    custom criteria: same code as in custom criteria of case "SCN-03 High closing risk"