test file "UrbanEV_BBW_Simulink_Test_Manager"

suite "Emergency Brake-Request Logic Verification"

  case "SCN-05 Sudden Stationary Obstacle" [baseline]
    description: This test case verifies SCN-05, the sudden stationary obstacle scenario.
      Expected outputs:
      warning_state_code = 3
      brake_request = 1
      state_match = 1
      State code 3 corresponds to EMERGENCY_BRAKE.
    model urban_ev_bbw_warning_logic_test_validation